# Grasshopper definition GraFit Network Components Example.gh (Grasshopper 1.0.7)
# plug-ins: Human, GraFitNodes

# ---- group: Test Network Geometry
crv_random_network_s = Curve([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])
crv_random_network_l = Curve([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])
crv_regular_grid = Curve([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])

# ----
explode = Explode(Curve=crv_random_network_l, Recursive=True)  # -> flatten(Segments), Vertices
line = Line(flatten(explode.Segments))
number_slider = Slider(0.926, range=0..1)
number_slider_2 = Slider(0.084, range=0..1)
number_slider_3 = Slider(1, range=0..1)
toggle = BooleanToggle(True)
lng = ListLength(List=graft(line))  # -> expr("x*1", flatten(Length))
buildgraph = BuildGraph(
    Lines=line,
    CustomWeightsForward=lng,
    CustomWeightsBackward=lng,
    LengthCoefficient=number_slider_3,
    AngleCoefficient=number_slider,
    CustomCoefficient=number_slider_2,
    GPU=toggle)  # -> Graph, Nodes, Edges
buildfloatgraph = BuildFloatGraph(
    Lines=line,
    CustomWeightsForward=lng,
    CustomWeightsBackward=lng,
    LengthCoefficient=number_slider_3,
    AngleCoefficient=number_slider,
    CustomCoefficient=number_slider_2,
    GPU=toggle)  # -> Graph, Nodes, Edges; disabled
all_nodes_geometry = Point(buildgraph.Nodes)
panel = Panel("""0
19
1""")
panel_2 = Panel("""10
9
11
26
22""")
c_all_nodes_ids = CSharpScript(nodes=all_nodes_geometry)  # -> out, A; inputs nodes: list of Int32
# ---------- c_all_nodes_ids: C# usings ----------
using System.Linq;
# ---------- c_all_nodes_ids: C# ----------
    A = nodes.Select((s, i) => i);
# ---------- end c_all_nodes_ids ----------
destination_list = Integer(panel_2)
origins_list = Integer(panel)
# For test weight matrix is filled with 1s
c_test_matrix = CSharpScript(From=origins_list, To=destination_list)  # -> out, DistanceMatrix; inputs From: list of Int32, To: list of Int32
# ---------- c_test_matrix: C# usings ----------
//using Grafit;
//using GrafitRhino;
using System.Linq;
# ---------- c_test_matrix: C# ----------
    int FromN = From.Count;
    int ToN = To.Count;

    var reducedODMatrix = new Matrix(FromN, ToN);

    for(int i = 0; i < FromN; i++)
    {
      for(int j = 0; j < ToN; j++)
      {
        reducedODMatrix[i, j] = 1;
      }
      reducedODMatrix[i, i] = 0;
    }



    DistanceMatrix = reducedODMatrix;

    return;
# ---------- end c_test_matrix ----------
node_ids = Panel("""2
6
8""")
edge_ids = Panel("""26
12""")
toggle_2 = BooleanToggle(True)
branch = TreeBranch(Tree=buildgraph.Edges, Path="{0}", MaintainPaths=True)
destination = Point(Point(-24.31010301, 57.33456044, 0))
origin = Point(Point(33.96818689, 27.10138241, 0))
# Slightly offseted edges for visualisation
c_move = CSharpScript(directedEdges=flatten(buildgraph.Edges))  # -> out, A; inputs directedEdges: list of Line
# ---------- c_move: C# ----------
    var lines = directedEdges.Take(directedEdges.Count() / 2).ToList();
    var translatedLines = new Line[lines.Count * 2];
    int index = 0;
    double distance = 0.05;



    foreach (Line line in lines)
    {
      Point3d midpoint = line.PointAt(0.5);
      Vector3d tangent = line.UnitTangent;
      Vector3d normal = Vector3d.CrossProduct(tangent, Vector3d.ZAxis);
      normal *= distance;
      Point3d start = line.From + normal;
      Point3d end = line.To + normal;
      Line translatedLine = new Line(start, end);

      translatedLines[index] = new Line(start, end);
      index++;
    }

    foreach (Line line in lines)
    {
      line.Flip();
      Point3d midpoint = line.PointAt(0.5);
      Vector3d tangent = line.UnitTangent;
      Vector3d normal = Vector3d.CrossProduct(tangent, Vector3d.ZAxis);
      normal *= distance;
      Point3d start = line.From + normal;
      Point3d end = line.To + normal;
      Line translatedLine = new Line(start, end);

      translatedLines[index] = new Line(start, end);
      index++;
    }


    A = translatedLines;
# ---------- end c_move ----------
undirectededges = Line(branch)
all_nodes_geometry_2 = Point(buildgraph.Nodes)
getgraphbc = GetGraphBC(
    Graph=buildgraph.Graph,
    ODWeightMatrix=flatten(c_test_matrix.DistanceMatrix),
    Origins=origins_list,
    Destinations=destination_list,
    GPU=toggle_2)  # -> BCN, BCE
getdistancematrix = GetDistanceMatrix(Graph=buildgraph.Graph, DistanceMatrixIndex=Slider(3, range=0..3), Origins=origins_list, Destinations=destination_list)
getgraphcc = GetGraphCC(Graph=buildgraph.Graph, DistanceMatrixIndex=0, GPU=toggle_2)  # -> CCN, CCE
getedgesbynode = GetEdgesByNode(Graph=buildgraph.Graph, NodeId=node_ids)
getnodesbyedge = GetNodesByEdge(Graph=buildgraph.Graph, EdgeId=edge_ids)
getgraphgeometry = GetGraphGeometry(Graph=buildgraph.Graph)  # -> Nodes, Edges
getshortestpath = GetShortestPath(Graph=buildgraph.Graph, Origin=origin, Destination=destination)  # -> Metric, Angle, Custom, Aggregated, Nodes, Edges
branch_2 = TreeBranch(Tree=getgraphbc.BCE, Path="{0; 0}", MaintainPaths=True)
branch_3 = TreeBranch(Tree=getgraphbc.BCE, Path="{0; 1}", MaintainPaths=True)
branch_4 = TreeBranch(Tree=getgraphbc.BCN, Path="{0}", MaintainPaths=True)
branch_5 = TreeBranch(Tree=getgraphcc.CCE, Path="{0; 0}", MaintainPaths=True)
branch_6 = TreeBranch(Tree=getgraphcc.CCE, Path="{0; 1}", MaintainPaths=True)
panel_3 = Panel([getshortestpath.Metric, getshortestpath.Angle, getshortestpath.Custom, getshortestpath.Aggregated])

# ---- group: Shortest Path
node_points_ids = Data(getshortestpath.Nodes)
edge_lines_ids = Data(getshortestpath.Edges)
swatch = ColourSwatch(SwatchColor=RGB(84, 199, 116))
item = ListItem(List=flatten(buildgraph.Edges), Index=edge_lines_ids, Wrap=True)
item_2 = ListItem(List=all_nodes_geometry_2, Index=node_points_ids, Wrap=True)
symsim = SymbolSimple(Style=7, Size=12, Rotation=0, Colour=swatch)
symbol = SymbolDisplay(Location=item_2, Display=symsim)
previewlw = CustomPreviewLineweights(Geometry=item, Shader=swatch, Thickness=Slider(5, range=0..10), Absolute=False)

# ---- group: Edges By Node Id
node_points_ids_2 = Data(node_ids)
edge_lines_ids_2 = Data(getedgesbynode)
swatch_2 = ColourSwatch(SwatchColor=RGB(247, 255, 0))
item_3 = ListItem(List=flatten(c_move.A), Index=edge_lines_ids_2, Wrap=True)
item_4 = ListItem(List=all_nodes_geometry_2, Index=node_points_ids_2, Wrap=True)
symsim_2 = SymbolSimple(Style=7, Size=12, Rotation=0, Colour=swatch_2)
symbol_2 = SymbolDisplay(Location=item_4, Display=symsim_2)
previewlw_2 = CustomPreviewLineweights(Geometry=item_3, Shader=swatch_2, Thickness=Slider(5, range=0..10), Absolute=False)

# ---- group: Nodes by Edge Id
node_points_ids_3 = Data(getnodesbyedge)
edge_lines_ids_3 = Data(edge_ids)
swatch_3 = ColourSwatch(SwatchColor=RGB(0, 255, 234))
item_5 = ListItem(List=flatten(c_move.A), Index=edge_lines_ids_3, Wrap=True)
item_6 = ListItem(List=all_nodes_geometry_2, Index=node_points_ids_3, Wrap=True)
symsim_3 = SymbolSimple(Style=7, Size=12, Rotation=0, Colour=swatch_3)
symbol_3 = SymbolDisplay(Location=item_6, Display=symsim_3)
previewlw_3 = CustomPreviewLineweights(Geometry=item_5, Shader=swatch_3, Thickness=Slider(5, range=0..10), Absolute=False)

# ---- group: Nodes
values_nodes = Number(branch_4)
log = Logarithm(Value=values_nodes)
bnd = Bounds(Numbers=log)
remap = RemapNumbers(Value=log, Source=bnd, Target=Domain(0, 1))  # -> Mapped, Clipped
gradient = Gradient(
    LowerLimit=0,
    UpperLimit=1,
    Parameter=remap.Mapped,
    stops=[0: RGB(0, 0, 139), 0.221: RGB(50, 178, 206), 0.709: RGB(255, 215, 0), 1: RGB(255, 0, 0)])
symsim_4 = SymbolSimple(Style=5, Size=Slider(6, range=0..10), Rotation=0, Colour=gradient)
symbol_4 = SymbolDisplay(Location=all_nodes_geometry_2, Display=symsim_4)

# ---- group: Edges
addition = Addition(A=branch_5, B=branch_6)
values_undirected_edges = Number(flatten(addition))
values_directed_edges = Number(flatten([branch_2, branch_3]))
log_2 = Logarithm(Value=values_directed_edges)
bnd_2 = Bounds(Numbers=log_2)
remap_2 = RemapNumbers(Value=log_2, Source=bnd_2, Target=Domain(0, 1))  # -> Mapped, Clipped
gradient_2 = Gradient(
    LowerLimit=0,
    UpperLimit=1,
    Parameter=remap_2.Mapped,
    stops=[0: RGB(0, 0, 139), 0.221: RGB(50, 178, 206), 0.709: RGB(255, 215, 0), 1: RGB(255, 0, 0)])
directed_edges = Curve(c_move.A)
previewlw_4 = CustomPreviewLineweights(Geometry=directed_edges, Shader=gradient_2, Thickness=Slider(5, range=0..10), Absolute=False)

# ---- group: Path as vectors
item_7 = ListItem(List=flatten(buildgraph.Edges), Index=edge_lines_ids, Wrap=True)
end = EndPoints(Curve=item_7)  # -> Start, End
vdis = VectorDisplay(Anchor=end.Start, Vector=item_7)

# ---- group: Show Ids
number_slider_4 = Slider(0.3, range=0..1)
number_slider_5 = Slider(0.07, range=0..1.1)
eval = EvaluateCurve(Curve=c_move.A, Parameter=Slider(0.5, range=0..1))  # -> Point, Tangent, Angle

# ----
undirectededges_2 = Line(undirectededges)

# ---- group: Show Ids / Edges
points = PointList(Points=eval.Point, Size=number_slider_5)

# ---- group: Show Ids / Nodes
points_2 = PointList(Points=all_nodes_geometry_2, Size=number_slider_4)
